# Dynamo graph test.dyn (Dynamo 2.13.1.3887)
# packages: Data-Shapes 2022.2.103

# group: Podešavanja/izbor ISO klase
code_block = CodeBlock { "ISO (klasa po GMPu)"; "OK"; true; "Prekid"; }
opis_iso_oznake = CodeBlock { "B"; "C"; "D"; "CNC"; "NC"; "PB"; "Ostale prostorije"; }
join = List.Join(list0=opis_iso_oznake.out0, list1=opis_iso_oznake.out1, list2=opis_iso_oznake.out2, list3=opis_iso_oznake.out3, list4=opis_iso_oznake.out4, list5=opis_iso_oznake.out5, list6=opis_iso_oznake.out6)
iso_oznake = CodeBlock { 6; 7; 8; 9; 10; 11; ""; }
join_2 = List.Join(list0=iso_oznake.out0, list1=iso_oznake.out1, list2=iso_oznake.out2, list3=iso_oznake.out3, list4=iso_oznake.out4, list5=iso_oznake.out5, list6=iso_oznake.out6)
# note: Custom Node: Data-Shapesv.2022.2.103
listview_data = Custom[Listview Data](Keys=join, Values=join_2)  # package Data-Shapes; Create data for ListView input in UI.MultiInputForm ++ . Check out www.data-shapes.net for more infos.
multipleinputform = Custom[MultipleInputForm ++](Description_optional=code_block.out0, ButtonText_optional=code_block.out1, Inputs=listview_data, Toggle=code_block.out2, CancelButtonText_optional=code_block.out3)  # package Data-Shapes; Create a form with multiple inputs. see www.data-shapes.net for tutorials and infos!
code_block_2 = CodeBlock(lista=multipleinputform.User_Inputs) { DSCore.List.Flatten(lista, -1); }

# group: Filter po parametru
boolean = BoolSelector(true)
placedRooms = Python(IN[0]=boolean)  # "Collector.PlacedRooms"; IronPython2
# ---------- placedRooms.python (36 lines) ----------
#Copyright(c) 2017, john pierson
# @60secondrevit, http://sixtysecondrevit.com

import clr
clr.AddReference('ProtoGeometry')
from Autodesk.DesignScript.Geometry import *

# Import DocumentManager and TransactionManager
clr.AddReference("RevitServices")
import RevitServices
from RevitServices.Persistence import DocumentManager
from RevitServices.Transactions import TransactionManager

# Import RevitAPI
clr.AddReference("RevitAPI")
import Autodesk
from Autodesk.Revit.DB import *

doc = DocumentManager.Instance.CurrentDBDocument
uiapp = DocumentManager.Instance.CurrentUIApplication
app = uiapp.Application

from System.Collections.Generic import *


#The inputs to this node will be stored as a list in the IN variable.
dataEnteringNode = IN
collector = FilteredElementCollector(doc)
rooms = collector.OfCategory(BuiltInCategory.OST_Rooms).ToElements()

roomInstances = []
for i in rooms:
	if i.Area != 0:
		roomInstances.append(i)

OUT = roomInstances
# ----------------------------------------
watch = Watch(placedRooms)
parameter_name = StringInput("ISO")
getParameterValueByName = Element.GetParameterValueByName(element=watch, parameterName=parameter_name)
ISO = Watch(getParameterValueByName)
eq = ISO == code_block_2  # lacing=CrossProduct
anyTrue = List.AnyTrue(list=eq@L2)
filterByBoolMask = List.FilterByBoolMask(list=watch, mask=anyTrue)
id = Element.Id(element=filterByBoolMask.in)
element_by_id = ElementById(Id=id)
finishBoundary = Room.FinishBoundary(room=element_by_id)

# group: Izbaci stubove
count = List.Count(list=finishBoundary@L3)
code_block_3 = CodeBlock { 1; }
sub = count - code_block_3
maximumItem = List.MaximumItem(list=sub)
code_block_4 = CodeBlock(n=maximumItem) { 1..(n+1); }

# group: Vector
removeItemAtIndex = List.RemoveItemAtIndex(list=finishBoundary@L3, indices=code_block_4)
code_block_5 = CodeBlock { 1; }
flatten = List.Flatten(list=removeItemAtIndex, amount=code_block_5)
tangentAtParameter = Curve.TangentAtParameter(curve=flatten, param=code_block_5)
shiftIndices = List.ShiftIndices(list=flatten@L2, amount=code_block_5)
tangentAtParameter_2 = Curve.TangentAtParameter(curve=shiftIndices, param=code_block_5)
isAlmostEqualTo = Vector.IsAlmostEqualTo(vector=tangentAtParameter, otherVector=tangentAtParameter_2)

# group: Remove Non-Corner Points
startPoint = Curve.StartPoint(curve=flatten)
filterByBoolMask_2 = List.FilterByBoolMask(list=startPoint, mask=isAlmostEqualTo)

# group: Find Top-Right Corner (max X+Y)
reverse = List.Reverse(list=filterByBoolMask_2.out@L2)
X = Point.X(point=reverse)
Y = Point.Y(point=reverse)
add = X + Y
maximumItem_2 = List.MaximumItem(list=add)
indexOf = List.IndexOf(list=add, element=maximumItem_2, lacing=Longest)
code_block_6 = CodeBlock(x=indexOf) { x*-1; }
shiftIndices_2 = List.ShiftIndices(list=reverse@L2, amount=code_block_6, lacing=Longest)

# group: Proračun uglova
ukupan_broj_uglova = List.Count(list=shiftIndices_2@L2)
code_block_7 = CodeBlock { 4; }
add_2 = ukupan_broj_uglova + code_block_7
# note: Petrova jednačina sa dve nepoznate
# S - Spoljašnju ugao (IGM)
# U - unutrašnji ugao (Holker)
# ToT - Ukupan broj uglova koje daje Dynamo
# S= U-4
# ToT= U+S
# ToT = U+U-4
# ToT = 2U-4
code_block_8 = CodeBlock { 2; }
div = add_2 / code_block_8
sub_2 = ukupan_broj_uglova - div

# group: 
# Nije potrebno za proračun, samo kontrole radi...
# note: Nije potrebno za proračun, samo kontrole radi...
total_bez_stubova = Watch(ukupan_broj_uglova)

# group: Parameter name
string = StringInput("4. Ćoškovi vrata")
string_2 = StringInput("1. Spoljašnji (IGM)")
string_3 = StringInput("2. Unutrašnji (Holker)")
string_4 = StringInput("0. Datum očitavanja")
list_create = List.Create(item0=string_2, item1=string_3, item2=string_4)
watch_2 = Watch(list_create)

# group: Verzije
istorija = CodeBlock()
# ---------- istorija.designscript (21 lines) ----------
// V7
"Dodat Datum očitavanja";

// V8
"Krenuto sa proračunom špiceva,
nije završeno";

// V9
"Dodat Filter za obradu soba po KLASI ( ISO )";

//v 10
"Dodat grafički izbor za iso klasu";

//v 11
"Broj panela u sobi - plafon i zid";

//v 12
"Dodato obaveštenje, i korigovana greška kod izdvajanja stubova";

//v 13
"Dorada za pyRevit";
# ----------------------------------------

# group: To Revit
parameters = Element.Parameters(element=watch)  # frozen
value = Parameter.Value(parameter=parameters)
geometry = Element.Geometry()  # frozen; unwired: element

# group: Broj panela u Sobi
code_block_9 = CodeBlock(PlacedRooms=watch) { PlacedRooms; }
code_block_10 = CodeBlock(placedRooms=code_block_9)
# ---------- code_block_10.designscript (7 lines) ----------
bb = Revit.Elements.Element.BoundingBox(placedRooms);
cuboidGeometry = Autodesk.BoundingBox.ToCuboid(bb);
point1 = Autodesk.Solid.Centroid(cuboidGeometry);
plane1 = Autodesk.Plane.ByOriginNormal(point1, Autodesk.Vector.ByCoordinates(0, 0, 1));

scaleXY = 1.00;
scaleZ = 1.1;
# ----------------------------------------
scale = Geometry.Scale(geometry=code_block_10.cuboidGeometry, plane=code_block_10.plane1, xamount=code_block_10.scaleXY, yamount=code_block_10.scaleXY, zamount=code_block_10.scaleZ)
boundingBox = Geometry.BoundingBox(geometry=scale)
elementInside = Python(IN[0]=boundingBox)  # CPython3
# ---------- elementInside.python (36 lines) ----------
import clr
clr.AddReference('RevitAPI')
clr.AddReference('System')
clr.AddReference('RevitNodes')
clr.AddReference('RevitServices')
import Revit
import RevitServices
from Autodesk.Revit.DB import *
from System.Collections.Generic import List
from RevitServices.Persistence import DocumentManager
from RevitServices.Transactions import TransactionManager
clr.ImportExtensions(Revit.Elements)
clr.ImportExtensions(Revit.GeometryConversion)
doc = DocumentManager.Instance.CurrentDBDocument

#Functions for list handling
def ProcessList(_func, _list):
   return map( lambda x: ProcessList(_func, x) if type(x)==list else _func(x), _list )

#Preparing input from dynamo to revit

def ToRevit(item):
	return item.ToRevitType(True)

if isinstance(IN[0], list):
	bblist = ProcessList(ToRevit, IN[0])
else:
	bblist = [ToRevit(IN[0])]

def collectElementsInBB(bb):
	outline = Outline(bb.Min, bb.Max)
	filter = BoundingBoxIntersectsFilter(outline)
	collector = FilteredElementCollector(doc, doc.ActiveView.Id).WherePasses(filter)
	return [e.ToDSType(True) for e in collector]

OUT = ProcessList(collectElementsInBB, bblist)
# ----------------------------------------

broj_panela_u_prostorijama = CodeBlock(room=code_block_9) { "Broj Zidnih Panela"; soba = room; "Broj Plafonskih Panela"; }

# group: Zidni
string_from_object = FromObject(object=elementInside)
code_block_11 = CodeBlock { "Curtain Panel"; }
contains = String.Contains(string=string_from_object, searchFor=code_block_11)
filterByBoolMask_3 = List.FilterByBoolMask(list=elementInside, mask=contains)
count_2 = List.Count(list=filterByBoolMask_3.in@L2)
setParameterByName = Element.SetParameterByName(element=broj_panela_u_prostorijama.soba, parameterName=broj_panela_u_prostorijama.out0, value=count_2)

# group: Plafonski
string_from_object_2 = FromObject(object=elementInside)
code_block_12 = CodeBlock { "FootPrintRoof"; }
contains_2 = String.Contains(string=string_from_object_2, searchFor=code_block_12)
filterByBoolMask_4 = List.FilterByBoolMask(list=elementInside, mask=contains_2)
count_3 = List.Count(list=filterByBoolMask_4.in@L2)
setParameterByName_2 = Element.SetParameterByName(element=broj_panela_u_prostorijama.soba, parameterName=broj_panela_u_prostorijama.out2, value=count_3)
countTrue = List.CountTrue(list=contains_2@L2)

# group: Izdvajanje stubova
code_block_13 = CodeBlock { 0; }
code_block_14 = CodeBlock { 0; }
removeItemAtIndex_2 = List.RemoveItemAtIndex(list=finishBoundary@L3, indices=code_block_14)
isEmpty = List.IsEmpty(list=removeItemAtIndex_2@L2)
allTrue = List.AllTrue(list=isEmpty)
flatten_2 = List.Flatten(list=removeItemAtIndex_2@L3)
if_ = RefactoredIf(test=allTrue, true=removeItemAtIndex_2, false=flatten_2)
count_4 = List.Count(list=if_@L2)

watch_3 = Watch(count_4)

# group: Zbirovi
watch_4 = Watch(element_by_id)
spoljašnji_igm = Watch(sub_2)
total_stubovi = Watch(watch_3)
add_3 = spoljašnji_igm + total_stubovi
zbir_stubova_i_spoljašnjih_u = Watch(add_3)  # "Zbir stubova i spoljašnjih u sobama"
unutrašnji_holker = Watch(div)

setParameterByName_3 = Element.SetParameterByName(element=watch_4)  # unwired: parameterName, value

# group: Datum očitavanja
now = DateTime.Now()
string_from_object_3 = FromObject(obj=now)
count_5 = List.Count(list=sub_2)
ofRepeatedItem = List.OfRepeatedItem(item=string_from_object_3, amount=count_5)
string_from_object_4 = FromObject(obj=ofRepeatedItem)

# group: Parameter Value
# note: 0 - Spoljašnji (IGM)
# 1 - Unutrašnji ( Holker)
# 2 - Datum očitavanja
# 3 - Ćoškovi vrata
list_create_2 = List.Create(item0=zbir_stubova_i_spoljašnjih_u, item1=unutrašnji_holker, item2=string_from_object_4)

watch_5 = Watch(list_create_2)
combine = List.Combine(comb=setParameterByName_3, list1=watch_2, list2=watch_5)
watch_6 = Watch(combine)
wait_for_it = CodeBlock(waitfor=watch_6) { ["Uspešno ćoškanje!",waitfor][0]; }
alert = Python(IN[0]=wait_for_it)  # CPython3
# ---------- alert.python (12 lines) ----------
import clr
clr.AddReference("RevitAPIUI")
from Autodesk.Revit.UI import TaskDialog

msg = IN[0]
title = "Broj ćoškova u prostorijama"
alert = TaskDialog

if msg == None or len(msg) == 0:
	OUT = "No Message To Show"
else:
	OUT = alert.Show(title, msg)
# ----------------------------------------
boundaries = CurtainPanel.Boundaries(curtainPanel=filterByBoolMask_3.in)
code_block_15 = CodeBlock(t1=filterByBoolMask_3.in) { t1@-1; }
code_block_16 = CodeBlock(a=filterByBoolMask_3.in) { a; }
